# Grasshopper definition bowl.gh (Grasshopper 1.0.7)

number_slider = Slider(24, range=0..100)  # disabled
number_slider_2 = Slider(23, range=0..100)  # disabled
number_slider_3 = Slider(34, range=0..100)  # disabled
number_slider_4 = Slider(34, range=0..100)
circle = Circle(Plane=PlaneXY(0, 0, 0), Radius=number_slider_2)  # disabled
circle_2 = Circle(Plane=PlaneXY(0, 0, 0), Radius=Slider(23, range=0..100))
offset_curve = OffsetCurve(Curve=circle, Distance=number_slider, Plane=PlaneXY(0, 0, 0), Corners=1)  # disabled
offset_curve_2 = OffsetCurve(Curve=circle_2, Distance=Slider(24, range=0..100), Plane=PlaneXY(0, 0, 0), Corners=1)
divide_curve = DivideCurve(Curve=circle, Count=number_slider_3, Kinks=False)  # -> Points, Tangents, Parameters; disabled
divide_curve_2 = DivideCurve(Curve=offset_curve, Count=number_slider_3, Kinks=False)  # -> Points, Tangents, Parameters; disabled
divide_curve_3 = DivideCurve(Curve=circle_2, Count=number_slider_4, Kinks=False)  # -> Points, Tangents, Parameters
divide_curve_4 = DivideCurve(Curve=offset_curve_2, Count=number_slider_4, Kinks=False)  # -> Points, Tangents, Parameters
dispatch = Dispatch(List=divide_curve.Points, DispatchPattern=[True, False])  # -> ListA, ListB; disabled
dispatch_2 = Dispatch(List=divide_curve_2.Points, DispatchPattern=[True, False])  # -> ListA, ListB; disabled
dispatch_3 = Dispatch(List=divide_curve_3.Points, DispatchPattern=[True, False])  # -> ListA, ListB
dispatch_4 = Dispatch(List=divide_curve_4.Points, DispatchPattern=[True, False])  # -> ListA, ListB
number_slider_5 = Slider(29, range=0..40)  # disabled
number_slider_6 = Slider(0.676, range=0..30)  # disabled
number_slider_7 = Slider(29, range=0..40)
weave = Weave(Pattern=[0, 1], Stream0=dispatch.ListA, Stream1=dispatch_2.ListB, NullGaps=False)  # disabled
weave_2 = Weave(Pattern=[0, 1], Stream0=dispatch_3.ListA, Stream1=dispatch_4.ListB, NullGaps=False)
series = Series(Start=0, Step=number_slider_6, Count=number_slider_5)  # disabled
number_slider_8 = Slider(2.99, range=0..7)  # disabled
series_2 = Series(Start=0, Step=Slider(0.676, range=0..30), Count=number_slider_7)
nurbs_curve = NurbsCurve(Vertices=weave, Degree=4, Periodic=True)  # -> Curve, Length, Domain; disabled
nurbs_curve_2 = NurbsCurve(Vertices=weave_2, Degree=4, Periodic=True)  # -> Curve, Length, Domain
unit_z = UnitZ(Factor=series)  # disabled
unit_z_2 = UnitZ(Factor=series_2)
move = Move(Geometry=nurbs_curve_2.Curve, Motion=unit_z_2)  # -> Geometry, Transform
offset_curve_3 = OffsetCurve(Curve=nurbs_curve.Curve, Distance=number_slider_8, Plane=PlaneXY(0, 0, 0), Corners=1)  # disabled
number_slider_9 = Slider(1.668, range=0..7)  # disabled
number_slider_10 = Slider(0, range=0..7)  # disabled
construct_domain = ConstructDomain(DomainStart=number_slider_10, DomainEnd=number_slider_9)  # disabled
insert_items = InsertItems(List=offset_curve_3, Item=nurbs_curve.Curve, Indices=1, Wrap=True)  # disabled
construct_domain_2 = ConstructDomain(DomainStart=Slider(0, range=0..7), DomainEnd=Slider(1.668, range=0..7))
range = Range(Domain=construct_domain, Steps=number_slider_5)  # disabled
boundary_surfaces = BoundarySurfaces(Edges=insert_items)  # disabled
range_2 = Range(Domain=Domain(0, 1), Steps=number_slider_5)  # disabled
range_3 = Range(Domain=construct_domain_2, Steps=number_slider_7)
range_4 = Range(Domain=Domain(0, 1), Steps=number_slider_7)
unit_z_3 = UnitZ(Factor=1)  # disabled
extrude = Extrude(Base=boundary_surfaces, Direction=unit_z_3)  # disabled
move_2 = Move(Geometry=extrude, Motion=unit_z)  # -> Geometry, Transform; disabled
area = Area(Geometry=move_2.Geometry)  # -> Area, Centroid; disabled
rotate = Rotate(Geometry=move_2.Geometry, Angle=range, Plane=PlaneXY(0, 0, 0))  # -> Geometry, Transform; disabled
graph_mapper = GraphMapper(range_2, x0=0, x1=1, y0=0, y1=1, Ox=0.02798439004, Oy=0.6937209964, Px=1, Py=0.23555547, container_name="Parabola")  # disabled
area_2 = Area(Geometry=move.Geometry)  # -> Area, Centroid
rotate_2 = Rotate(Geometry=move.Geometry, Angle=range_3, Plane=PlaneXY(0, 0, 0))  # -> Geometry, Transform
graph_mapper_2 = GraphMapper(range_4, x0=0, x1=1, y0=0, y1=1, Ox=0.02798439004, Oy=0.6937209964, Px=1, Py=0.23555547, container_name="Parabola")
scale = Scale(Geometry=rotate.Geometry, Center=area.Centroid, Factor=graph_mapper)  # -> Geometry, Transform; disabled
scale_2 = Scale(Geometry=rotate_2.Geometry, Center=area_2.Centroid, Factor=graph_mapper_2)  # -> Geometry, Transform
reverse_list = ReverseList(List=scale_2.Geometry)
loft = Loft(Curves=scale.Geometry, Options={Adjust=False, Closed=False, LoftEnds=0, LoftSimp=0, LoftType=0, Rebuild=10, Refit=0.01})  # disabled
list_item = ListItem(List=reverse_list, Index=0, Wrap=True)
boundary_surfaces_2 = BoundarySurfaces(Edges=list_item)
loft_2 = Loft(
    Curves=scale_2.Geometry,
    Options={Adjust=False, Closed=False, LoftEnds=0, LoftSimp=0, LoftType=0, Rebuild=10, Refit=0.01})
solid_union = SolidUnion(Breps=[boundary_surfaces_2, loft_2])
scale_3 = Scale(Geometry=solid_union, Center=Point(0, 0, 0), Factor=Slider(0.96, range=0..1))  # -> Geometry, Transform
loft_3 = Loft(
    Curves=[solid_union, scale_3.Geometry],
    Options={Adjust=False, Closed=False, LoftEnds=0, LoftSimp=0, LoftType=0, Rebuild=10, Refit=0.01})
series_3 = Series(Start=Slider(1, range=0..5), Step=Slider(0.2, range=0.2..1.2), Count=Slider(3, range=0..5))
insert_items_2 = InsertItems(List=loft_3, Item=[scale_3.Geometry, solid_union], Indices=0, Wrap=True)
boundary_volume = BoundaryVolume(Boundaries=insert_items_2)
scale_4 = Scale(Geometry=boundary_volume, Center=Point(0, 0, 0), Factor=series_3)  # -> Geometry, Transform
