# Grasshopper definition lamp.gh (Grasshopper 1.0.7)

circle = Circle(Plane=PlaneXY(0, 0, 0), Radius=Slider(3.832, range=0..15))
circle_2 = Circle(Plane=PlaneXY(0, 0, 0), Radius=Slider(4.521, range=0..18))
circle_3 = Circle(Plane=PlaneXY(0, 0, 0), Radius=Slider(13.833, range=0..18))
circle_4 = Circle(Plane=PlaneXY(0, 0, 0), Radius=Slider(3, range=0..3))
circle_5 = Circle(Plane=PlaneXY(0, 0, 0), Radius=Slider(15, range=0..15))
unit_z = UnitZ(Factor=Slider(1.31, range=0..30))
unit_z_2 = UnitZ(Factor=Slider(9, range=0..30))
unit_z_3 = UnitZ(Factor=Slider(3, range=0..30))
unit_z_4 = UnitZ(Factor=Slider(13, range=0..30))
move = Move(Geometry=circle, Motion=unit_z)  # -> Geometry, Transform
move_2 = Move(Geometry=circle_3, Motion=unit_z_2)  # -> Geometry, Transform
move_3 = Move(Geometry=circle_2, Motion=unit_z_3)  # -> Geometry, Transform
move_4 = Move(Geometry=circle_5, Motion=unit_z_4)  # -> Geometry, Transform
insert_items = InsertItems(List=circle_4, Item=[move.Geometry, move_3.Geometry, move_2.Geometry, move_4.Geometry], Indices=1, Wrap=True)
number_slider = Slider(6, range=0..10)
number_slider_2 = Slider(5, range=0..10)
loft = Loft(Curves=insert_items, Options={Adjust=False, Closed=False, LoftEnds=0, LoftSimp=0, LoftType=0, Rebuild=10, Refit=0.01})
unit_z_5 = UnitZ(Factor=1)
geometry = Geometry([<brep referenced from the Rhino model> x4, <curve referenced from the Rhino model> x792])
box = Box({Plane=PlaneXY(-60.56935325, 21.08988076, 0), X=Domain(0, 44.46608734), Y=Domain(0, 42.70505417), Z=Domain(0, 13.15453029)})
extrude = Extrude(Base=geometry, Direction=unit_z_5)
group = Group()
surface_morph = SurfaceMorph(Geometry=extrude, Reference=box, Surface=loft, UDomain=Domain(0, -1), VDomain=Domain(0, -1), WDomain=Domain(0, -1))
