# Grasshopper definition lamp.gh (Grasshopper 1.0.7)

cone = Cone(Base=PlaneXY(0, 0, 0), Radius=Slider(9, range=0..15), Length=Slider(28, range=0..30))  # -> Cone, Tip
circle = Circle(Plane=PlaneXY(0, 0, 0), Radius=Slider(2, range=0..15))
circle_2 = Circle(Plane=PlaneXY(0, 0, 0), Radius=Slider(3.631, range=0..18))
number_slider = Slider(15, range=0..30)
circle_3 = Circle(Plane=PlaneXY(0, 0, 0), Radius=Slider(8.133, range=0..18))
circle_4 = Circle(Plane=PlaneXY(0, 0, 0), Radius=Slider(1.55, range=0..3))
circle_5 = Circle(Plane=PlaneXY(0, 0, 0), Radius=Slider(9, range=0..15))
xy_plane = XYPlane(Origin=Point(0, 0, 0))
plane_offset = PlaneOffset(BasePlane=xy_plane, Offset=number_slider)
rotate = Rotate(Geometry=cone.Cone, Angle=Slider(180, range=0..180), Plane=xy_plane)  # -> Geometry, Transform
unit_z = UnitZ(Factor=Slider(0.86, range=0..30))
unit_z_2 = UnitZ(Factor=Slider(9, range=0..30))
unit_z_3 = UnitZ(Factor=Slider(5, range=0..30))
unit_z_4 = UnitZ(Factor=Slider(15, range=0..30))
center_box = CenterBox(Base=plane_offset, X=number_slider, Y=number_slider, Z=1)
move = Move(Geometry=circle, Motion=unit_z)  # -> Geometry, Transform
move_2 = Move(Geometry=circle_3, Motion=unit_z_2)  # -> Geometry, Transform
move_3 = Move(Geometry=circle_2, Motion=unit_z_3)  # -> Geometry, Transform
move_4 = Move(Geometry=circle_5, Motion=unit_z_4)  # -> Geometry, Transform
insert_items = InsertItems(List=circle_4, Item=[move.Geometry, move_3.Geometry, move_2.Geometry, move_4.Geometry], Indices=1, Wrap=True)
split_brep = SplitBrep(Brep=rotate.Geometry, Cutter=center_box)
loft = Loft(Curves=insert_items, Options={Adjust=False, Closed=False, LoftEnds=0, LoftSimp=0, LoftType=0, Rebuild=10, Refit=0.01})
list_item = ListItem(List=split_brep, Index=Slider(1, range=0..1), Wrap=True)
flip = Flip(Surface=loft)  # -> Surface, Result
brep_edges = BrepEdges(Brep=list_item)  # -> Naked, Interior, NonManifold
boundary_surfaces = BoundarySurfaces(Edges=brep_edges.Naked)
list_item_2 = ListItem(List=boundary_surfaces, Index=Slider(1, range=0..1), Wrap=True)
circle_6 = Circle(Plane=list_item_2, Radius=Slider(1.55, range=0..3))
solid_difference = SolidDifference(BrepsA=list_item_2, BrepsB=circle_6)
flip_2 = Flip(Surface=solid_difference)  # -> Surface, Result
solid_union = SolidUnion(Breps=[list_item, flip_2.Surface])
